# Grasshopper definition test.gh (Grasshopper 0.9.76)

dom = ConstructDomain(DomainStart="-10", DomainEnd="10")
range = Range(Domain=dom, Steps=Slider(124, range=10..250))
eval = Evaluate(F="ln(x)", x=range)
pt = ConstructPoint(XCoordinate=range, YCoordinate=eval, ZCoordinate=0)
panel = Panel(eval)
number_slider = Slider(14.25, range=0..20)
intcrv = Interpolate(Vertices=pt, Degree=3, Periodic=False, KnotStyle=1)  # -> Curve, Length, Domain
extr = Extrude(Base=intcrv.Curve)
